% Requirement links of AutopilotControlSystem.slx (R2019a)

block :2953 implements electricUAVReqs.slreqx#30: Waypoint Orbiting
block :3348 implements electricUAVReqs.slreqx#31: Automatic Return to Land
block :3453 implements electricUAVReqs.slreqx#29: Waypoint Traversal
block :3761::100 implements electricUAVReqs.slreqx#31: Automatic Return to Land
block :3761::205 implements electricUAVReqs.slreqx#29: Waypoint Traversal
block :3761::861 implements electricUAVReqs.slreqx#30: Waypoint Orbiting
block :3869 implements electricUAVReqs.slreqx#47: Trim Conditions Capture
block :3878 implements electricUAVReqs.slreqx#45: CTRL_3: Turnrate Controller
block :3878 implements electricUAVReqs.slreqx#58: CTRL_4: Yaw Damper
block :3893 implements electricUAVReqs.slreqx#66: YD_2: Trim Position Contribution to Altitude Controller
block :3895 implements electricUAVReqs.slreqx#63: BAHOLD_2: Trim Position Contribution to Altitude Controller
block :3896 implements electricUAVReqs.slreqx#62: BAHOLD_1: Aileron Command Saturation
block :3985 implements electricUAVReqs.slreqx#65: YD_1: Rudder Command Saturation
block :4077 implements electricUAVReqs.slreqx#44: Altitude Controller
block :4077 implements electricUAVReqs.slreqx#43: Airspeed Controller
block :4095 implements electricUAVReqs.slreqx#56: Trim Position Contribution to Airspeed Controller
block :4098 implements electricUAVReqs.slreqx#52: Trim Position Contribution to Altitude Controller
block :4205 implements electricUAVReqs.slreqx#50: Elevator Command Saturation
block :4209 implements electricUAVReqs.slreqx#51: Altitude Controller Anti-Windup Protection
block :4368 implements electricUAVReqs.slreqx#48: Rate-Limit Altitude Command
block :4368 implements electricUAVReqs.slreqx#49: Altitude Rate Limiter's Initial Conditions
block :4398 implements electricUAVReqs.slreqx#53: Pitch Command Saturation
block :4399 implements electricUAVReqs.slreqx#54: Throttle Command Saturation
block :4763 implements electricUAVReqs.slreqx#40: Filtering
block :4769 implements electricUAVReqs.slreqx#40: Filtering
block :4770 implements electricUAVReqs.slreqx#40: Filtering
block :4777 implements electricUAVReqs.slreqx#40: Filtering
block :4778 implements electricUAVReqs.slreqx#40: Filtering
block :4779 implements electricUAVReqs.slreqx#40: Filtering
block :4933 implements electricUAVReqs.slreqx#59: GDNC_5: Maximum Roll Angle Command
block :4958 implements electricUAVReqs.slreqx#59: GDNC_5: Maximum Roll Angle Command
block :5031 implements electricUAVReqs.slreqx#55: Airspeed Controller Anti-Windup Protection
block :5106 implements electricUAVReqs.slreqx#68: YD_4: Lateral Acceleration Filtering
block :5178 implements electricUAVReqs.slreqx#64: BAHOLD_5: Roll Angle Controller Anti-Windup Protection
block :5250 implements electricUAVReqs.slreqx#67: YD_3: Roll Angle Controller Anti-Windup Protection
block :5275 implements electricUAVReqs.slreqx#39: Temperature Compensation
block :5290 implements electricUAVReqs.slreqx#49: Altitude Rate Limiter's Initial Conditions