# Requirement set electricUAVReqs (R2019a)

## 1 [#25] Flight Controller
Aircraft shall provide an off-the-shelof flight computer to autonomously control the aircraft from launch to recovery

### 1.1 [#38] Sensors (Container)

#### 1.1.1 [SENS_1] Temperature Compensation
All sensor drivers shall account for temperature-induced bias in their readings

#### 1.1.2 [SENS_2] Filtering
Al sensor drivers shall filter for noise reading at a bandwidth of 40 Hz.

### 1.2 [#41] Guidance (Container)

#### 1.2.1 [GDNC_1] Waypoint Traversal
Aricraft shall follow a given set of waypoints by the operator via a ground control station in triads of latitude, longitude, and height.

#### 1.2.2 [GDNC_2] Waypoint Orbiting
Aricraft shall orbit at around a given waypoint in a triad of Latitude, Longitude and Height, by the operator via a ground control station

#### 1.2.3 [GDNC_3] Automatic Return to Land
Aricraft shall return to lanch location and land upon receiving such command from the operator via a ground control station.

#### 1.2.4 [GDNC_5] Maximum Roll Angle Command
The commanded roll angle, produced by the guidance logic, shall not exceed 25 degrees in either direction.

#### 1.2.5 [GDNC_6] Airspeed Command Limits
The commanded airspeed, produced by the guidance logic, shall be, at all times between 14 and 35 m/s

#### 1.2.6 [GDNC_7] Altitude Command Limits
The commanded altitude, produced by the guidance logic, shall never be less than the altitude of the ground station plus 20 meters.

### 1.3 [#42] Control (Container)

#### 1.3.1 [CTRL_1] Airspeed Controller
Aircraft shall be able to reach and hold a commanded airspeed from an outside component.

##### 1.3.1.1 [UHOLD_1] Throttle Command Limits
Speed Controller shall provide means to limit the computed throttle command from 0% to 95%

##### 1.3.1.2 [UHOLD_2] Airspeed Controller Anti-Windup Protection
All integrators part of the airspeed controller shall implement logic to avoid the numerical phenomenon knows as integrator-windup.

##### 1.3.1.3 [UHOLD_3] Trim Position Contribution to Airspeed Controller
Airspeed Controller shall account for captured throttle trim conditions when producing throttle commands.

#### 1.3.2 [CTRL_2] Altitude Controller
Aircraft shall be able to reach and hold a commanded altitude from an outside component.

##### 1.3.2.1 [HHOLD_1] Rate-Limit Altitude Command
Altitude Controller shall limit the rate at which the altitude command is received.

##### 1.3.2.2 [HHOLD_2] Altitude Rate Limiter's Initial Conditions
The Altitude Command Rate Limiter shall account for initial conditions different than zero and appropriately reset upon changing these.

##### 1.3.2.3 [HHOLD_3] Pitch Command Saturation
Altitude Controller shall provide means to sature the pitch command produced in the Height Error controller to 35 degrees in either direction.

##### 1.3.2.4 [HHOLD_4] Elevator Command Saturation
Altitude Controller shall provide means to saturate the computed elevator command to 23 degrees in either direction

##### 1.3.2.5 [HHOLD_5] Altitude Controller Anti-Windup Protection
All integrators part of the altitude controller shall implement logic to avoid the numerical phenomenon knows as integrator-windup.

##### 1.3.2.6 [HHOLD_6] Trim Position Contribution to Altitude Controller
Altitude Controller shall account for captured elevator trim conditions when producing elevator commands.

#### 1.3.3 [CTRL_3] Roll Angle Controller
Aircraft shall be able to reach and hold a commanded roll from an outside component.

##### 1.3.3.1 [BAHOLD_1] Aileron Command Saturation
Roll Angle Controller shall provide means to saturate the computed aileron command to 30 degrees in either direction

##### 1.3.3.2 [BAHOLD_2] Trim Position Contribution to Altitude Controller
Roll Angle Controller shall account for captured aileron trim conditions when producing aileron commands.

##### 1.3.3.3 [BAHOLD_5] Roll Angle Controller Anti-Windup Protection
All integrators part of the roll angle controller shall implement logic to avoid the numerical phenomenon knows as integrator-windup.

#### 1.3.4 [CTRL_4] Yaw Damper
Flight controller shall implement a yaw damper that eliminates lateral accelerations during coordinated turns.

##### 1.3.4.1 [YD_1] Rudder Command Saturation
Yaw Damper shall provide means to saturate the computed rudder command to 10 degrees in either direction

##### 1.3.4.2 [YD_2] Trim Position Contribution to Yaw Damper
Yaw Damper shall account for captured rudder trim conditions when producing rudder commands.

##### 1.3.4.3 [YD_3] Roll Angle Controller Anti-Windup Protection
All integrators part of the yaw damper shall implement logic to avoid the numerical phenomenon knows as integrator-windup.

##### 1.3.4.4 [YD_4] Lateral Acceleration Filtering
Lateral Acceleration (a_y) readings shall be filtered for noise at a bandwidth of 10 Hz before passed to the Yaw Damper.

#### 1.3.5 [CTRL_5] Trim Conditions Capture
Upon transition from manual to autonomous flight, the Flight Controller shall capture the current control surface position and consider these as trim position of these.